# Grasshopper definition surface_mapping_network.gh (Grasshopper 1.0.4)

number_slider = Slider(3000, range=0..3000)
number_slider_2 = Slider(3, range=0..10)
planesrf = PlaneSurface(Plane=PlaneXY(0, 0, 0), XSize=number_slider, YSize=number_slider)
series = Series(Start=0, Step=number_slider, Count=number_slider_2)
series_2 = Series(Start=0, Step=number_slider, Count=Slider(4, range=0..10))
srf = Surface([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])

# ---- group: cylinder as looping surfaces
cyl = Cylinder(Base=PlaneXY(0, 0, 0), Radius=Slider(3500, range=0..4000), Length=Slider(9000, range=0..10000))
python = GhPythonScript()  # -> out, a
# ---------- python: Python ----------
__author__ = "ytakzk"
__version__ = "2019.02.23"

import Rhino.Geometry as rg

a = []

for i in range(3):
    
    a.append(rg.Interval(i/3, (i + 1)/3))
# ---------- end python ----------
dom² = ConstructDomain²(DomainU=python.a, DomainV=graft(python.a))  # -> flatten(_2DDomain)
subsrf = Isotrim(Surface=reparameterize(cyl), Domain=dom²)
python_2 = GhPythonScript(x=subsrf)  # -> out, a; inputs x: list of Surface
# ---------- python_2: Python ----------
__author__ = "ytakzk"
__version__ = "2019.02.23"

import Rhino.Geometry as rg

for s in x[3:6]:

    s.Reverse(0, True)
    domain = rg.Interval(0, 1)
    s.SetDomain(0, domain)

import random
random.shuffle(x)
a = x
# ---------- end python_2 ----------

# ----
X = UnitX(Factor=series)
Y = UnitY(Factor=series_2)  # -> graft(UnitVector)
bbox = BoundingBox(Content=srf, Plane=PlaneXY(0, 0, 0))  # -> Box, Box_2
move = Move(Geometry=planesrf, Motion=X)  # -> Geometry, Transform
box = EvaluateBox(Box=bbox.Box, UParameter=0.5, VParameter=0.5, WParameter=0.5)  # -> Plane, Point, Include
lng = ListLength(List=bbox.Box)
move_2 = Move(Geometry=move.Geometry, Motion=Y)  # -> flatten(Geometry), Transform
ma = MassAddition(Input=box.Point)  # -> Result, PartialResults
division = Division(A=ma.Result, B=lng)
scale_nu = ScaleNU(Geometry=srf, Plane=division, ScaleX=Slider(1, range=0..3), ScaleY=Slider(1, range=0..3), ScaleZ=1)  # -> Geometry, Transform

# ---- group: keystone surfaces 2
srf_2 = Surface(scale_nu.Geometry)

# ----
srf_3 = Surface(move_2.Geometry)

# ---- group: Jonas's surfaces
srf_4 = Surface([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])
python_3 = GhPythonScript(surfaces=srf_4)  # -> out, a; inputs surfaces: list of Surface
# ---------- python_3: Python ----------
__author__ = "ytakzk"
__version__ = "2019.02.24"

import Rhino.Geometry as rg

a = []

for i, s in enumerate(surfaces):
    
    domain = rg.Interval(0, 1)
    
    if i > 1:
        s = s.Reverse(0)
        s.SetDomain(0, domain)
    
    a.append(s)
# ---------- end python_3 ----------

# ---- group: in reality, must be done manually
python_4 = GhPythonScript(surfaces=srf_3, u_num=number_slider_2)  # -> out, organized_surfaces; inputs surfaces: list of Surface, u_num: Int32
# ---------- python_4: Python ----------
__author__ = "ytakzk"
__version__ = "2019.02.20"

import Rhino.Geometry as rg

organized_surfaces = []

for i, s in enumerate(surfaces):
    
    x = i % u_num
    y = int(i / u_num)
    
    domain = rg.Interval(0, 1)
    
#    if (x + y) % 2 == 1:
#        s = s.Reverse(1)
#        s.SetDomain(1, domain)
#        s = s.Reverse(0)
#        s.SetDomain(0, domain)

    if y % 2 == 1:
#        s = s.Reverse(1)
#        s.SetDomain(1, domain)
        s = s.Reverse(0)
        s.SetDomain(0, domain)
    
    if x == u_num - 1:
        s = s.Reverse(0)
        s.SetDomain(0, domain)
        
    organized_surfaces.append(s)
# ---------- end python_4 ----------

# ---- group: one surface
item = ListItem(List=srf_3, Index=0, Wrap=True)
srf_5 = Surface(item)

# ----
python_5 = GhPythonScript(surfaces=srf_2)  # -> out, organized_surfaces; inputs surfaces: list of Surface
# ---------- python_5: Python ----------
__author__ = "ytakzk"
__version__ = "2019.02.25"

import Rhino.Geometry as rg

organized_surfaces = []

for i, s in enumerate(surfaces):
    
    if i == 0 or i == 1 or i == 5:
        s.Reverse(0, True)
        domain = rg.Interval(0, 1)
        s.SetDomain(0, domain)
    
    organized_surfaces.append(s)
# ---------- end python_5 ----------

# ---- group: keystone surfaces
srf_6 = Surface([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])

# ----
srf_7 = Surface([<surface referenced from the Rhino model> x3])
python_6 = GhPythonScript(surfaces=srf_7)  # -> out, beams, dowels, tmp, warped_surfaces, local_networks; inputs surfaces: list of Surface
# ---------- python_6: Python ----------
__author__ = "ytakzk"
__version__ = "2019.02.23"

import sys
import Rhino.Geometry as rg

from geometry import LocalNetwork, GlobalNetwork

dowels = []
beams = []
tmp = []

global_network = GlobalNetwork(surfaces, u_div=3, v_div=5, offset_value=20, type_args=[40, 20, 20, True, False, False])

local_networks = global_network.local_networks

for local_network in local_networks:
    
    local_dowels = local_network.add_three_beams_connection()
    dowels.extend([d.brep_representation() for d in local_dowels])

    local_dowels = local_network.add_two_beams_connection()
    dowels.extend([d.brep_representation() for d in local_dowels])

    local_beams = [b.brep_representation(make_holes=False) for b in local_network.get_flatten_beams()]
    beams.extend(local_beams)

warped_surfaces = [s.surface for s in global_network.surfaces]
# ---------- end python_6 ----------
uvn = UVN(srf=srf_7)
python_7 = GhPythonScript(toggle=Button())  # -> out, a
# ---------- python_7: Python ----------
__author__ = "ytakzk"
__version__ = "2019.01.21"

import geometry

if toggle:
    
    reload(geometry)
# ---------- end python_7 ----------

# ---- group: numbering for keystones
python_8 = GhPythonScript(s=python_6.warped_surfaces)  # -> out, center; inputs s: Surface
# ---------- python_8: Python ----------
__author__ = "ytakzk"
__version__ = "2019.02.25"


import Rhino.Geometry as rg

center = s.PointAt(0.5, 0.5)
# ---------- end python_8 ----------
points = PointList(Points=python_8.center, Size="600")

# ----
geo = Geometry(python_6.dowels)
geo_2 = Geometry(python_6.beams)
preview = CustomPreview(
    Geometry=geo_2,
    Material={diffuse=RGB(0, 0, 205), emission=RGB(66, 48, 66), shine=0.5, specular=RGB(255, 255, 255), transparency=0.7})
srf_8 = Surface([<surface referenced from the Rhino model> x3])
number_slider_3 = Slider(3, range=0..5)
srf_9 = Surface([<surface referenced from the Rhino model> x3])
srf_10 = Surface([<surface referenced from the Rhino model> x3])
number_slider_4 = Slider(8, range=-10..10)
number_slider_5 = Slider(0, range=0..0.2)

# ---- group: keystone generation
python_9 = GhPythonScript(
    surfaces=python_6.warped_surfaces,
    keystone_index_list="2, 1, 0",
    start_index=number_slider_4,
    start_split=number_slider_5,
    v_val=number_slider_3)  # -> out, sss; inputs surfaces: list of Surface, start_index: Int32, v_val: Int32
# ---------- python_9: Python ----------
__author__ = "ytakzk"
__version__ = "2019.02.24"

import System
import Rhino.Geometry as rg
import Grasshopper.Kernel.Data.GH_Path as ghpath
import Grasshopper.DataTree as datatree
from geometry import Keystone

keystone_surfaces = datatree[System.Object]()

# ceonvert string to nested numerical list

index_nested_list = []

for vals in keystone_index_list.split('\n'):
    print vals
    nums = [int(v) for v in vals.split(',')]
    index_nested_list.append(nums)

print index_nested_list

#for i, index_list in enumerate(index_nested_list):
#    
#    surfaces = [surfaces[i] for i in index_list]
#
#    keystone = Keystone(surfaces, split_function=1)
#    _, generated_surfaces = keystone.output()
#    
#    for s in generated_surfaces:
#        path = ghpath(i)
#        keystone_surfaces.Add(s, path)

locations = [1, 0] #[s_index % 2 , (s_index+1) % 2]

sss = []

keystone_srfs = []

for s_index, index_list in enumerate(index_nested_list):
    
    tmp_surfaces = [surfaces[i] for i in index_list]
    
    print s_index
    print s_index % 2, (s_index + 1) % 2
    keystone = Keystone(tmp_surfaces, v_div = v_val, split_function=1, f_args = [[0, 0, .15, .05], [start_index, start_split, .15, .05], []], \
        loc_pat = locations, blend_overlap = 5, dir = True)
    print "keystone.loc : ", keystone.loc
    print "v_div :", keystone.v_div
        
    keystone_srfs
    _, ss = [s for s in keystone.output()]
    
    sss.append(ss)
# ---------- end python_9 ----------

# ----
python_10 = GhPythonScript(
    surfaces=srf_8,
    keystone_index_list="2, 1, 0",
    start_index=number_slider_4,
    start_split=number_slider_5,
    v_val=number_slider_3)  # -> out, sss; inputs surfaces: list of Surface, start_index: Int32, v_val: Int32; same code as python_9
python_11 = GhPythonScript(
    surfaces=srf_9,
    keystone_index_list="0, 1, 2",
    start_index=number_slider_4,
    start_split=number_slider_5,
    v_val=number_slider_3)  # -> out, sss; inputs surfaces: list of Surface, start_index: Int32, v_val: Int32; same code as python_9
python_12 = GhPythonScript(
    surfaces=srf_10,
    keystone_index_list="2, 1, 0",
    start_index=number_slider_4,
    start_split=number_slider_5,
    v_val=number_slider_3)  # -> out, sss; inputs surfaces: list of Surface, start_index: Int32, v_val: Int32; same code as python_9
flatten = FlattenTree(Tree=python_9.sss, Path="{0}")
number_slider_6 = Slider(9, range=0..10)
item_2 = ListItem(List=python_9.sss, Index=0, Wrap=True)
python_13 = GhPythonScript(surfaces=python_10.sss, v_val=number_slider_3, u_val=number_slider_6)  # -> out, beams, dowels, local_networks; inputs surfaces: list, v_val: Int32, u_val: Int32
# ---------- python_13: Python ----------
__author__ = "ytakzk"
__version__ = "2019.02.23"

import sys
import Rhino.Geometry as rg

from geometry import LocalNetwork, GlobalNetwork

dowels = []
beams = []
tmp = []


print v_val, u_val
for ii, ss in enumerate(surfaces):
    
    global_network = GlobalNetwork(ss, u_div=u_val, v_div = v_val, will_reverse=ii == 0)
    
    local_networks = global_network.local_networks
    
    for local_network in local_networks:
        
        local_dowels = local_network.add_three_beams_connection()
        dowels.extend([d.brep_representation() for d in local_dowels])
    
        local_dowels = local_network.add_two_beams_connection()
        dowels.extend([d.brep_representation() for d in local_dowels])
    
        local_beams = [b.brep_representation(make_holes=False) for b in local_network.get_flatten_beams()]
        beams.extend(local_beams)
    

warped_surfaces = [s.surface for s in global_network.surfaces]
# ---------- end python_13 ----------
python_14 = GhPythonScript(surfaces=python_11.sss, v_val=number_slider_3, u_val=number_slider_6)  # -> out, beams, dowels, local_networks; inputs surfaces: list, v_val: Int32, u_val: Int32; same code as python_13
item_3 = ListItem(List=flatten, Index=Slider(5, range=0..5), Wrap=True)
python_15 = GhPythonScript(surfaces=python_12.sss, v_val=number_slider_3, u_val=number_slider_6)  # -> out, beams, dowels, local_networks; inputs surfaces: list, v_val: Int32, u_val: Int32; same code as python_13

# ---- group: beams on keystones
python_16 = GhPythonScript(surfaces=python_9.sss, v_val=number_slider_3, u_val=number_slider_6)  # -> out, beams, dowels, local_networks; inputs surfaces: list, v_val: Int32, u_val: Int32; same code as python_13

# ----
panel = Panel(python_9.sss)

# ---- group: fabrication sequence check
merge = Merge(Data1=python_16.local_networks, Data2=python_6.local_networks)  # -> flatten(Result)
python_17 = GhPythonScript(local_networks=merge)  # -> out, beams, dowels; inputs local_networks: list
# ---------- python_17: Python ----------
__author__ = "ytakzk"
__version__ = "2019.02.24"

import System
import Grasshopper.Kernel.Data.GH_Path as ghpath
import Grasshopper.DataTree as datatree

beams = datatree[System.Object]()

for i, local_network in enumerate(local_networks):
    
    local_beams = [b.brep_representation(make_holes=False) for b in local_network.get_flatten_beams()]
    
    path = ghpath(i)
    
    for b in local_beams:
        beams.Add(b, path)
# ---------- end python_17 ----------
panel_2 = Panel(python_17.beams)
item_4 = ListItem(List=python_17.beams, Index=Slider(4, range=0..20), Wrap=True)
preview_2 = CustomPreview(
    Geometry=item_4,
    Material={diffuse=RGB(0, 255, 255), emission=RGB(66, 48, 66), shine=0.5, specular=RGB(255, 255, 255), transparency=0.3})

# ==== cluster UVN
srf = ClusterInput()
number_slider = Slider(5, range=0..110)
extract_uv_vec = GhPythonScript(srf=srf)  # -> out, center_pt, u_vec, v_vec, normal; inputs srf: Surface
# ---------- extract_uv_vec: Python ----------
__author__ = "Wenqian"
__version__ = "2019.01.22"

import rhinoscriptsyntax as rs
import Rhino.Geometry as rg

srf.SetDomain(0,rg.Interval(0,1))
srf.SetDomain(1,rg.Interval(0,1))

center_pt = srf.PointAt(0.5,0.5)

u_vec = srf.FrameAt(0.5,0.5)[1].XAxis
v_vec = srf.FrameAt(0.5,0.5)[1].YAxis

normal =srf.NormalAt(0.5,0.5)
# ---------- end extract_uv_vec ----------
multiplication = Multiplication(A=extract_uv_vec.v_vec, B=500)
multiplication_2 = Multiplication(A=extract_uv_vec.normal, B=500)
multiplication_3 = Multiplication(A=extract_uv_vec.u_vec, B=500)
vdisex = VectorDisplayEx(
    Point=extract_uv_vec.center_pt,
    Vector=multiplication_3,
    Colour=ColourSwatch(SwatchColor=RGB(255, 0, 0)),
    Width=number_slider)
vdisex_2 = VectorDisplayEx(
    Point=extract_uv_vec.center_pt,
    Vector=multiplication,
    Colour=ColourSwatch(SwatchColor=RGB(33, 220, 0)),
    Width=number_slider)
vdisex_3 = VectorDisplayEx(
    Point=extract_uv_vec.center_pt,
    Vector=multiplication_2,
    Colour=ColourSwatch(SwatchColor=RGB(255, 255, 255)),
    Width=number_slider)
